% Simulink data dictionary Adaptive_Cruise_Control.sldd

In_Camera_Input_Lead_Vehicle = mpt.Signal(StorageClass="ImportedExtern", DataType="uint8", Min=0, Max=255)
In_Radar_Input_Lead_Vehicle = mpt.Signal(StorageClass="ImportedExtern", DataType="uint8", Min=0, Max=255)
In_Camera_Input_Drive_Vehicle = mpt.Signal(StorageClass="ImportedExtern", DataType="uint8", Min=0, Max=255)
In_Radar_Input_Drive_Vehicle = mpt.Signal(StorageClass="ImportedExtern", DataType="uint8", Min=0, Max=255)
In_Time_Gap = mpt.Signal(StorageClass="ImportedExtern", DataType="uint8", Min=0, Max=255)
In_Set_Speed = mpt.Signal(StorageClass="ImportedExtern", DataType="uint8", Min=0, Max=255)
In_Set_Gap = mpt.Signal(StorageClass="ImportedExtern", DataType="uint8", Min=0, Max=255)
In_Cruise_Switch = mpt.Signal(StorageClass="ImportedExtern", DataType="boolean", Min=0, Max=1)
In_Set_Switch = mpt.Signal(StorageClass="ImportedExtern", DataType="boolean", Min=0, Max=1)
Out_Acceleration_Mode = mpt.Signal(StorageClass="ExportToFile", DataType="uint8", Min=0, Max=255)
Out_Lead_Vehicle_Speed = mpt.Signal(StorageClass="ExportToFile", DataType="uint8", Min=0, Max=255)
Out_Drive_Vehicle_Speed = mpt.Signal(StorageClass="ExportToFile", DataType="uint8", Min=0, Max=255)
Out_Lead_Vehicle_Detected = mpt.Signal(StorageClass="ExportToFile", DataType="uint8", Min=0, Max=255)