% Simulink data dictionary Lane_Changing_Assistant.sldd

Highway_Display_Mode_1 = mpt.Signal(StorageClass="Localizable", DataType="uint8", Min=0, Max=255)
Highway_Display_Mode_2 = mpt.Signal(StorageClass="Localizable", DataType="uint8", Min=0, Max=255)
Highway_Display_Mode_3 = mpt.Signal(StorageClass="Localizable", DataType="uint8", Min=0, Max=255)
Highway_Display_Mode_4 = mpt.Signal(StorageClass="Localizable", DataType="uint8", Min=0, Max=255)
Lane_Display_Mode_1 = mpt.Signal(StorageClass="Localizable", DataType="uint8", Min=0, Max=255)
Lane_Display_Mode_2 = mpt.Signal(StorageClass="Localizable", DataType="uint8", Min=0, Max=255)
Lane_Display_Mode_3 = mpt.Signal(StorageClass="Localizable", DataType="uint8", Min=0, Max=255)
Lane_Display_Mode_4 = mpt.Signal(StorageClass="Localizable", DataType="uint8", Min=0, Max=255)
Highway_Input_Signal = mpt.Signal(DataType="uint8", Min=0, Max=255)
Enable_Display = mpt.Signal(DataType="uint8", Min=0, Max=255)
Input_Switch = mpt.Signal(DataType="uint8", Min=0, Max=255)
Lane_Input_Signal = mpt.Signal(DataType="uint8", Min=0, Max=255)
Display_Mode_1 = mpt.Signal(DataType="uint8", Min=0, Max=255)
Display_Mode_2 = mpt.Signal(DataType="uint8", Min=0, Max=255)
Display_Mode_3 = mpt.Signal(DataType="uint8", Min=0, Max=255)
Display_Mode_4 = mpt.Signal(DataType="uint8", Min=0, Max=255)