% Simulink data dictionary TrafficJamAssistant.sldd

VOLTAGE_MAXIMUM_RANGE = mpt.Parameter(50, StorageClass="Global", DataType="uint8")
VOLTAGE_MINIMUM_RANGE = mpt.Parameter(30, StorageClass="Global", DataType="uint8")
INTERRUPT_2 = mpt.Parameter(1, StorageClass="Global", DataType="boolean")
NO_DISPLAY = mpt.Parameter(0, StorageClass="Global", DataType="uint8")
STANDBY_MODE = mpt.Parameter(3, StorageClass="SimulinkGlobal", DataType="uint8")
Optimum_Voltage = mpt.Signal(StorageClass="Localizable", DataType="boolean", Min=0, Max=1)  % Optimum_Voltage : local signal to be used in the DisplayUnit subsystem
OFF_MODE = mpt.Parameter(2, StorageClass="SimulinkGlobal", DataType="uint8")
ON_MODE = mpt.Parameter(1, StorageClass="SimulinkGlobal", DataType="uint8")
Input_Switch = mpt.Signal(StorageClass="Struct", StructName="InputStruct", DataType="boolean", Min=0, Max=1)
Enable_Display = mpt.Signal(StorageClass="Struct", StructName="InputStruct", DataType="uint8", Min=0, Max=255)
Input_Voltage = mpt.Signal(StorageClass="Struct", StructName="InputStruct", DataType="uint8", Min=0, Max=255)
Output_Display = mpt.Signal(StorageClass="Struct", StructName="OutputStruct", DataType="uint8", Min=0, Max=255)
INTERRUPT_1 = mpt.Parameter(1, StorageClass="Global", DataType="boolean")