% Simulink data dictionary Vehicle_Direction_Detection.sldd

SteeringWheel_YawDegreeInput = mpt.Signal(StorageClass="ImportedExtern", DataType="int16", Min=-180, Max=180)
CameraInput_RoadSign = mpt.Signal(StorageClass="ImportedExtern", DataType="boolean", Min=0, Max=1)
Vehicle_Turn_Status = mpt.Signal(StorageClass="Localizable", DataType="int16", Min=-180, Max=180)
Right_Turn_AngularLimit = mpt.Parameter(30, StorageClass="Const", DataType="int16", Min=-180, Max=180)
Left_Turn_AngularLimit = mpt.Parameter(-120, StorageClass="Const", DataType="int16", Min=-180, Max=180)
Straight_Drive_Steering_Angle = mpt.Parameter(0, StorageClass="Const", DataType="int16", Min=-180, Max=180)
RightTurn_RoadSign = mpt.Parameter(30, StorageClass="Const", DataType="int16", Min=-180, Max=180)
LeftTurn_RoadSign = mpt.Parameter(-120, StorageClass="Const", DataType="int16", Min=-180, Max=180)
Straight_RoadSign = mpt.Parameter(0, StorageClass="Const", DataType="int16", Min=-180, Max=180)
Vehicle_Direction_Indicator = mpt.Signal(StorageClass="ExportToFile", DataType="boolean", Min=0, Max=1)